# Grasshopper definition 9_ML_Inference.ghx (Grasshopper 1.0.8)
# plug-ins: Eddy3D

pedestrian_level = Panel("1.8")

# ---- group: Buildings
brep = Brep([<brep referenced from the Rhino model> x23])

# ----
preview = CustomPreview(Geometry=brep, Material=ColourSwatch(SwatchColor=RGB(204, 204, 204)))

# ---- group: TERRAIN
srf = Surface(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)

# ----
Z = UnitZ(Factor=pedestrian_level)
path = FilePath("C:\Users\ilker\Desktop\FNO\hybrid_fno.onnx")

# ---- group: wind direction
list = ValueList({"North": 0, "Northeast": 45, "East": 90, "Southeast": 135, "South": 180, "Southwest": 225, "West": 270, "Northwest": 315}, selected="South")

# ----
move = Move(Geometry=srf, Motion=Z)  # -> Geometry, Transform

# ---- group: ONNX File
path_2 = FilePath("C:\Users\ilker\Desktop\Conditional_Transformer\Pix2PixHD_Model\pix2pixhd_model.onnx")

# ----
brep2grid = BrepToGridPoints(Geometry=move.Geometry, Spacing="2", Run=True)  # -> Points, Status

# ---- group: Legend Settings
list_2 = ValueList({"Jet": "jet", "Turbo": "turbo", "Viridis": "viridis", "Magma": "magma", "Plasma": "plasma", "Inferno": "inferno", "Coolwarm": "coolwarm", "Pastel": "pastel", "Gray": "gray"}, selected="Jet")
dom = ConstructDomain(DomainStart=0, DomainEnd="5")

# ----
windpredict = WindPredictor(
    Points=brep2grid.Points,
    Buildings=brep,
    ONNXPath=path_2,
    U_ref="5",
    Z_ref=10,
    Pedestrian_level=pedestrian_level,
    Wind_dir=list,
    GPU=True,
    FilterMargin=100,
    Palette=list_2,
    LegendDomain=dom,
    Interpolate=False)  # -> X, Y, WindSpeed, GridMesh, LegendMesh, LegendPoints, LegendValues
bnd = Bounds(Numbers=windpredict.WindSpeed)
mesh = Mesh(windpredict.GridMesh)
mesh_2 = Mesh(windpredict.LegendMesh)
tag = TextTag(Location=windpredict.LegendPoints, Text=windpredict.LegendValues, Colour=RGB(0, 0, 0))

# ---- group: Wind speed range
panel = Panel(bnd)
